# Grasshopper definition 네이버1784(9F).gh (Grasshopper 1.0.8)
# plug-ins: Rhino.Inside for Autodesk Revit

# ---- group: 6. 천장·조명 (09F, Revit 전용 요소)
# 주의: 이 데이터는 참고·기록용입니다. 천장과 조명은 Revit에서 직접 만든 요소라 Revit 생성 컴포넌트에는 연결하지 않았습니다. Rhino 객체는 층별모델::09F::천장 / 조명 레이어에 있습니다.
천장_높이_09f_레벨_위_mm = 천장높이09F레벨위Mm(3200)
천장_윤곽선_바깥_개구부 = 천장윤곽선바깥개구부([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])
조명_위치_09f_천장 = 조명위치09F천장([Point(1610, 1410, 36800), Point(1610, 3810, 36800), Point(1610, 6210, 36800), Point(1610, 8610, 36800), Point(1610, 11010, 36800), Point(1610, 13410, 36800)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])
조명_rhino_id = 조명RhinoID(["02f5c7bd-db0e-41c5-a6c5-f7944d111b56", "0b035694-c035-4cb2-8401-e9d26ee34bfd", "35081886-b5e9-4cac-876e-44c9f5838d0c", "d73c4f1e-a27d-47b8-9227-5537d65aa64e", "6892f6f1-9358-43e4-a740-8f1cfcb8b411", "c505def3-224a-4771-ab57-0595670a84db"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])
조명_타입 = 조명타입(["트로퍼 - 포물선 정사각형 600 x 600mm(4 램프)", "트로퍼 - 포물선 정사각형 600 x 600mm(4 램프)", "트로퍼 - 포물선 정사각형 600 x 600mm(4 램프)", "트로퍼 - 포물선 정사각형 600 x 600mm(4 램프)", "트로퍼 - 포물선 정사각형 600 x 600mm(4 램프)", "트로퍼 - 포물선 정사각형 600 x 600mm(4 램프)"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])

# ---- group: 1. 레벨 · 평면도
series = Series(Start=0, Step=4200, Count=29)
레벨_이름 = Panel("""01F
02F
03F
04F
05F
06F
07F
08F
09F
10F
11F
12F
13F
14F
15F
16F
17F
18F
19F
20F
21F
22F
23F
24F
25F
26F
27F
28F
RF""")
add_level = AddLevel(Elevation=series, Name=레벨_이름, TrackingMode=2)  # disabled
add_floor_plan = AddFloorPlan(Level=add_level, Name=레벨_이름, TrackingMode=2)  # disabled

# ---- group: 2. 슬라브 → 바닥 (일반 150mm)
# 재질 메모: 재질: 바닥 타입 '일반 150mm' 의 구조층 = 구조_노출 콘크리트 (Revit API로 적용)
슬라브_윤곽선 = Curve([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])
슬라브_레벨_번호 = Integer(8)
바닥_타입 = Type(<hostobjecttype referenced from the Revit model>)
슬라브_레벨 = ListItem(List=add_level, Index=슬라브_레벨_번호, Wrap=True)  # disabled
add_floor = AddFloor(Boundary=슬라브_윤곽선, Type=바닥_타입, Level=슬라브_레벨, Structural=False, TrackingMode=2)  # disabled

# ---- group: 3. 구조기둥 (1000x1000, 수직, 상단 -150, 28F 제외)
# 재질 메모: 재질: 타입 '1000 x 1000' 구조 재질 = 구조_노출 콘크리트 (Revit API로 적용)
기둥_축선 = Curve(Tree({0}: [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], {1}: [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], {2}: [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], {3}: [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], {4}: [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], {5}: [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]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))
기둥_하부_레벨_번호 = Integer(Tree({0}: [8], {1}: [8], {2}: [8], {3}: [8], {4}: [8], {5}: [8]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))
기둥_상부_레벨_번호 = Integer(Tree({0}: [9], {1}: [9], {2}: [9], {3}: [9], {4}: [9], {5}: [9]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))
기둥_원본_타입 = Type(<familysymbol referenced from the Revit model>)
기둥_타입_이름 = Text("1000 x 1000")
B = Text("B")
b_값 = Number(1000)
H = Text("H")
h_값 = Number(1000)
기둥_하부_레벨 = ListItem(List=add_level, Index=기둥_하부_레벨_번호, Wrap=True)  # disabled
기둥_상부_레벨 = ListItem(List=add_level, Index=기둥_상부_레벨_번호, Wrap=True)  # disabled
duplicate_type = DuplicateType(TypeName=기둥_타입_이름, Type=기둥_원본_타입, TrackingMode=2)  # disabled
element_parameter = ElementParameter(Element=duplicate_type, Parameter=B, Value=b_값)  # -> Element, Value; disabled
element_parameter_2 = ElementParameter(Element=element_parameter.Element, Parameter=H, Value=h_값)  # -> Element, Value; disabled
add_structural_column = AddStructuralColumn(Curve=기둥_축선, Type=element_parameter_2.Element, BaseLevel=기둥_하부_레벨, TopLevel=기둥_상부_레벨, TrackingMode=2)  # disabled
기둥_스타일_파라미터 = Text("기둥 스타일")
integer = Integer(0)
element_parameter_3 = ElementParameter(Element=add_structural_column, Parameter=기둥_스타일_파라미터, Value=integer)  # -> Element, Value; disabled
_28f_제외_패턴 = Boolean(Tree({0}: [True], {1}: [True], {2}: [True], {3}: [True], {4}: [True], {5}: [True]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))
상단_간격띄우기_파라미터 = Text("상단 간격띄우기")
상단_오프셋_값 = Number(-150)
_28f_제외 = CullPattern(List=element_parameter_3.Element, CullPattern=_28f_제외_패턴)  # disabled
# 주의: 주의: Revit 요소를 만드는 컴포넌트(잠금 표시)는 잠금을 풀거나 전체 재계산(F5)하지 마세요.
# Revit API 밖에서 재계산되면 평면도/바닥/기둥이 삭제될 수 있습니다.
# 벽 상단 구속조건(윗층)·상단 간격띄우기 -150 은 Revit API로 직접 적용했습니다 (이 정의에는 없음).
# 바닥·기둥·외벽 형상은 라이노 형상을 값으로 저장한 것이라 라이노 수정이 자동 반영되지 않습니다.
# [Rhino 정보 연동] Revit 공유 파라미터: Rhino 이름 / Rhino 레이어 / Rhino ID / Rhino 재질 (바닥·기둥·벽·일반모델 3,424개).
# 재질 13종 = Rhino 레이어 재질과 동일. 파라미터 파일: Revit\Rhino_공유파라미터.txt
# [기록] 평면도 01F~28F는 Revit API로 재생성됨 (평면도 생성 컴포넌트와 연결 안 됨). 레벨 생성/평면도 생성의 과거 오류·경고 메시지는 정리함.
# [정리] List Item/Flatten/Cull 등 중간 컴포넌트도 잠금 (상위 Revit 컴포넌트가 잠겨 데이터가 없어서 경고가 뜨던 것).
element_parameter_4 = ElementParameter(Element=_28f_제외, Parameter=상단_간격띄우기_파라미터, Value=상단_오프셋_값)  # -> Element, Value; disabled

# ---- group: 4. 내벽·코어 → Revit 벽 (200/250/600mm)
# 재질 메모: 재질: 벽 타입 '내벽 코어 200/250/600mm' = 구조_코어벽 (밝은 회색) (Revit API로 적용)
벽_원본_타입 = Data(<hostobjecttype referenced from the Revit model>)
벽_타입_이름 = Text(Tree({0}: ["내벽 코어 200mm"], {1}: ["내벽 코어 250mm"], {2}: ["내벽 코어 600mm"]))
벽_두께 = Number(Tree({0}: [200], {1}: [250], {2}: [600]))
벽_중심선 = Curve(Tree({0}: [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], {1}: [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], {2}: [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], {3}: [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], {4}: [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], {5}: [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]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))
벽_높이 = Number(Tree({0}: [4200], {1}: [4200], {2}: [4200], {3}: [4200], {4}: [4200], {5}: [4200]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))
벽_레벨_번호 = Integer(Tree({0}: [8], {1}: [8], {2}: [8], {3}: [8], {4}: [8], {5}: [8]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))
벽_타입_번호 = Integer(Tree({0}: [0], {1}: [0], {2}: [0], {3}: [1], {4}: [1], {5}: [1]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))
duplicate_type_2 = DuplicateType(TypeName=벽_타입_이름, Type=벽_원본_타입, TrackingMode=2)  # disabled
construct_compound_structure_layer = ConstructCompoundStructureLayer(Thickness=벽_두께)  # disabled
construct_compound_structure = ConstructCompoundStructure(CoreLayers=construct_compound_structure_layer)  # disabled
벽_레벨 = ListItem(List=add_level, Index=벽_레벨_번호, Wrap=True)  # disabled
host_type_compound_structure = HostTypeCompoundStructure(Type=duplicate_type_2, Structure=construct_compound_structure)  # -> Type, Structure; disabled
벽_타입_목록 = FlattenTree(Tree=host_type_compound_structure.Type, Path="{0}")  # disabled
벽_타입 = ListItem(List=벽_타입_목록, Index=벽_타입_번호, Wrap=True)  # disabled
add_wall_curve = AddWallCurve(Curve=벽_중심선, Type=벽_타입, Level=벽_레벨, Height=벽_높이, AllowJoins=True, TrackingMode=2)  # disabled

# ---- group: 5. 외벽 DirectShape (일반 모델)
타워_수직루버_이름 = Text("타워 수직루버 09F")
타워_수직루버_형상 = Mesh(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)
수직루버_재질 = Data(<material referenced from the Revit model>)
키네틱_타공패널_이름 = Text()
키네틱_타공패널_형상 = Mesh()
키네틱패널_재질 = Data()
기타_외벽_이름 = Text(Tree({0}: ["타워 트리플스킨--캐비티 그레이팅 - 타워 캐비티 그레이팅 09F"], {1}: ["타워 트리플스킨--멀리언 - 타워 멀리언 09F"], {2}: ["타워 트리플스킨--외측 저반사유리 - 타워 외측 저반사유리 동측"], {3}: ["타워 트리플스킨--외측 저반사유리 - 타워 외측 저반사유리 남측"], {4}: ["타워 트리플스킨--외측 저반사유리 - 타워 외측 저반사유리 서측"], {5}: ["타워 트리플스킨--외측 저반사유리 - 타워 외측 저반사유리 북측"], {6}: ["타워 트리플스킨--내측 단열유리 - 타워 내측 단열유리 09F 동측"], {7}: ["타워 트리플스킨--내측 단열유리 - 타워 내측 단열유리 09F 남측"], {8}: ["타워 트리플스킨--내측 단열유리 - 타워 내측 단열유리 09F 서측"], {9}: ["타워 트리플스킨--내측 단열유리 - 타워 내측 단열유리 09F 북측"], {10}: ["타워 트리플스킨--스팬드럴 패널 - 타워 스팬드럴 09F"]))
기타_외벽_형상 = Geometry(Tree({0}: [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], {1}: [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], {2}: [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], {3}: [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], {4}: [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], {5}: [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], {6}: [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], {7}: [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], {8}: [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], {9}: [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], {10}: [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]))
기타외벽_재질 = Data(Tree({0}: [<material referenced from the Revit model>], {1}: [<material referenced from the Revit model>], {2}: [<material referenced from the Revit model>], {3}: [<material referenced from the Revit model>], {4}: [<material referenced from the Revit model>], {5}: [<material referenced from the Revit model>], {6}: [<material referenced from the Revit model>], {7}: [<material referenced from the Revit model>], {8}: [<material referenced from the Revit model>], {9}: [<material referenced from the Revit model>], {10}: [<material referenced from the Revit model>]))
add_directshape_geometry = AddDirectShapeGeometry(Name=타워_수직루버_이름, Geometry=타워_수직루버_형상, Material=수직루버_재질, TrackingMode=2)  # disabled
add_directshape_geometry_2 = AddDirectShapeGeometry(Name=키네틱_타공패널_이름, Geometry=키네틱_타공패널_형상, Material=키네틱패널_재질, TrackingMode=2)  # disabled
add_directshape_geometry_3 = AddDirectShapeGeometry(Name=기타_외벽_이름, Geometry=기타_외벽_형상, Material=기타외벽_재질, TrackingMode=2)  # disabled
